vi "FM_Modulator.gvi"   [LabVIEW Communications System Design Suite 2.0.1]
panel controls:
  "message amplitude": f64 = 1
  "message frequency": f64 = 10
  "error in": error
  "samples": i32 = 1000
  "sample rate": f64 = 1000
  "delta f": f64[]
  "carrier frequency": f64 = 10
  "carrier amplitude": f64 = 1
uses:
  NI::Analysis::Generation::Sine Waveform.gvi
  NI::Analysis::IntegralDifferentiation::Integral x(t).gvi
diagram:
  call "Sine Waveform.gvi"(amplitude=$"message amplitude", frequency=$"message frequency", error in=$"error in", sample rate=$"sample rate", samples=$samples) -> (sine wave=w1, error out=w2)
  call "Integral x(t).gvi"(x(t)=w1, error in=w2) -> (integral x(t)=w3)
  Multiply(w3, $"delta f") -> w4
  Multiply(w4, PiTimes2) -> w5
  Property Node(instance in=w5)
  Sine And Cosine()
  call "Sine Waveform.gvi"(amplitude=$"carrier amplitude", frequency=$"carrier frequency", phase in=90, sample rate=$"sample rate", samples=$samples)
